% Simulink data dictionary data_definitions.sldd

AuralSystemInterface = Simulink.ServiceBus()
  vAuralSystemInit: vAuralSystemInit(), Asynchronous=false
  vAuralSystemPlayWarningLevelChime: vAuralSystemPlayWarningLevelChime(), Asynchronous=false
  vAuralSystemPlayFaultLevelChime: vAuralSystemPlayFaultLevelChime(), Asynchronous=false

Motor = enum()
  enum1 = 0
  LEFT_MOTOR = 0  % Left Motor
  RIGHT_MOTOR = 1  % Right Motor

MotorSpin = enum()
  enum1 = 0
  CLOCKWISE = 0  % Clock-whise direction
  COUNTER_CLOCKWISE = 1  % Counter clock-wise direction

MotorCommands = Simulink.Bus()
  xLeftMotorSpinDirection: MotorSpin
  xRightMotorSpinDirection: MotorSpin
  fLeftMotorSpeed: float
  fRightMotorSpeed: float

ImuReadings = Simulink.Bus()
  fAccelX: float
  fAccelY: float
  fAccelz: float
  fGyroX: float
  fGyroY: float
  fGyroz: float

intPointer = Simulink.Bus()
  mem_add: fixdt(1,8)
  val: int32

floatPointer = Simulink.Bus()
  mem_add: fixdt(1,8)
  val: float

MotorCommandsPointer = Simulink.Bus()
  mem_add: fixdt(1,8)
  val: MotorCommands

ImuReadingsPointer = Simulink.Bus()
  mem_add: fixdt(1,8)
  val: ImuReadings

TelemetryDataPointer = Simulink.Bus()
  mem_add: fixdt(1,8)
  val: TelemetryData

VoidFunctionPointer = Simulink.AliasType(BaseType="function_handle")

BatteryVoltageSystemInterface = Simulink.ServiceBus()
  vBatterySystemInit: vBatterySystemInit(pBatteryCharge), Asynchronous=false, Arguments=Simulink.BusElement(Name="pBatteryCharge", DataType="Bus: floatPointer")
  vBatterySystemComputeMeasurement: vBatterySystemComputeMeasurement(), Asynchronous=false

CollisionSensorInterface = Simulink.ServiceBus()
  vCollisionSensorInit: vCollisionSensorInit(pCollisionCallBack), Asynchronous=false, Arguments=Simulink.BusElement(
  Name="pCollisionCallBack",
  Description="Pointer to Callback function",
  DataType="VoidFunctionPointer")
  vCollisionSensorDetectionHandler: vCollisionSensorDetectionHandler(), Asynchronous=false

ImuInterface = Simulink.ServiceBus()
  vImuInit: vImuInit(pImuReadings), Asynchronous=false, Arguments=Simulink.BusElement(Name="pImuReadings", DataType="Bus: ImuReadingsPointer")
  vImuComputeMeasurements: vImuComputeMeasurements(), Asynchronous=false

InfraredDistanceSystemInterface = Simulink.ServiceBus()
  vInfraredDistanceSystemInit: vInfraredDistanceSystemInit(pDistanceMeasurement), Asynchronous=false, Arguments=Simulink.BusElement(Name="pDistanceMeasurement", DataType="Bus: floatPointer")
  vInfraredDistanceSystemComputeMeasurement: vInfraredDistanceSystemComputeMeasurement(), Asynchronous=false

LineSensorSystemInterface = Simulink.ServiceBus()
  LineSensorSystemInit: LineSensorSystemInit(pLineSensorsReadings), Asynchronous=false, Arguments=Simulink.BusElement(Name="pLineSensorsReadings", DataType="Bus: floatPointer", Dimensions=5)

PowerTrainSystemInterface = Simulink.ServiceBus()
  vPowerTrainSystemInit: vPowerTrainSystemInit(), Asynchronous=false
  vPowerTrainSystemSetMotorDirection: vPowerTrainSystemSetMotorDirection(xMotor,xDirection), Asynchronous=false, Arguments=[Simulink.BusElement(Name="xMotor", DataType="Enum: Motor"), Simulink.BusElement(Name="xDirection", DataType="Enum: MotorSpin")]
  vPowerTrainSystemSetMotorSpeed: vPowerTrainSystemSetMotorSpeed(xMotor,fSpeed), Asynchronous=false, Arguments=[Simulink.BusElement(Name="xMotor", DataType="Enum: Motor"), Simulink.BusElement(Name="fSpeed", Unit="m/s", DataType="double")]

StateEstimate = Simulink.Bus()
  fTotalDistance: float
  fCurrentSpeed: float
  fAverageSpeed: float
  fCurrentRotationalSpeed: float
  fCurrentOrientation: float

StateEstimatePointer = Simulink.Bus()
  mem_add: fixdt(1,8)
  val: StateEstimate

ComSystemInterface = Simulink.ServiceBus()
  vComSystemInit: vComSystemInit(pTelemetryData,pStateEstimate,pMotorCommands), Asynchronous=false, Arguments=[Simulink.BusElement(Name="pTelemetryData", DataType="Bus: TelemetryDataPointer"), Simulink.BusElement(Name="pStateEstimate", DataType="Bus: StateEstimatePointer"), Simulink.BusElement(Name="pMotorCommands", DataType="Bus: MotorCommandsPointer")]
  vComSystemSendRobotData: vComSystemSendRobotData(), Asynchronous=false
  vComSystemParseIncomingData: vComSystemParseIncomingData(), Asynchronous=false

EstimationSystemInterface = Simulink.ServiceBus()
  vEstimationSystemInit: vEstimationSystemInit(pStateEstimation,pTelemetryData,pMotorCommands), Asynchronous=false, Arguments=[Simulink.BusElement(Name="pStateEstimation", DataType="Bus: StateEstimatePointer"), Simulink.BusElement(Name="pTelemetryData", DataType="Bus: TelemetryDataPointer"), Simulink.BusElement(Name="pMotorCommands", DataType="Bus: MotorCommandsPointer")]
  vEstimationSystemComputeEstimate: vEstimationSystemComputeEstimate(), Asynchronous=false

ControlSystemInterface = Simulink.ServiceBus()
  vControlSystemInit: vControlSystemInit(pMotorCommands,pStateEstimation,pTelemetryData), Asynchronous=false, Arguments=[Simulink.BusElement(Name="pMotorCommands", DataType="Bus: MotorCommandsPointer"), Simulink.BusElement(Name="pStateEstimation", DataType="Bus: StateEstimatePointer"), Simulink.BusElement(Name="pTelemetryData", DataType="Bus: TelemetryDataPointer")]
  vControlSystemComputeMotorCommands: vControlSystemComputeMotorCommands(), Asynchronous=false

TelemetryData = Simulink.Bus()
  xImuReadings: ImuReadings
  fLineSensorsData: uint32[5]
  fUltrasonicDistanceData: float
  fBatteryChargeData: float
  fLeftMotorPwm: float
  fRightMotorPwm: float

UltrasonicDistanceSystemInterface = Simulink.ServiceBus()
  vUltrassonicDistanceSystemInit: vUltrassonicDistanceSystemInit(pDistanceMeasurement), Asynchronous=false, Arguments=Simulink.BusElement(Name="pDistanceMeasurement", DataType="Bus: floatPointer")
  vUltrassonicDistanceSystemExecuteMeasurement: vUltrassonicDistanceSystemExecuteMeasurement(), Asynchronous=false
  vUltrassonicDistanceSystemPulseHandler: vUltrassonicDistanceSystemPulseHandler(), Asynchronous=true

TelemetrySystemInterface = Simulink.ServiceBus()
  vTelemetrySystemInit: vTelemetrySystemInit(pTelemetryData), Asynchronous=false, Arguments=Simulink.BusElement(Name="pTelemetryData", DataType="Bus: TelemetryDataPointer")
  vTelemetrySystemSchedulingHandler: vTelemetrySystemSchedulingHandler(pTIM), Asynchronous=true, Arguments=Simulink.BusElement(Name="pTIM", DataType="TIM_HandleTypeDef*")
  vTelemetrySystemExternalEventHandler: vTelemetrySystemExternalEventHandler(uiGpioPin), Asynchronous=true, Arguments=Simulink.BusElement(Name="uiGpioPin", DataType="uint16")
  vTelemetrySystemCaptureHandler: vTelemetrySystemCaptureHandler(pTIM), Asynchronous=true, Arguments=Simulink.BusElement(Name="pTIM", DataType="TIM_HandleTypeDef*")

EncoderSystemInterface = Simulink.ServiceBus()
  vEncoderSystemInit: vEncoderSystemInit(pLeftMotorCount,pRightMotorCount), Asynchronous=false, Arguments=[Simulink.BusElement(Name="pLeftMotorCount", DataType="Bus: intPointer"), Simulink.BusElement(Name="pRightMotorCount", DataType="Bus: intPointer")]
  vEncoderSystemExecuteMeasurement: vEncoderSystemExecuteMeasurement(), Asynchronous=false
  vEncoderSystemCounterUpdate: vEncoderSystemCounterUpdate(pTim), Asynchronous=false, Arguments=Simulink.BusElement(Name="pTim", DataType="TIM_HandleTypeDef*")