# Requirement set software_requirements (R2024a)

## 1 [SFW0001] The Software must comunicate via Bluetooth

### 1.1 [SFW0002] The Software must mantain a stable connection once the app is started

### 1.2 [SFW0003] The must receive as data: Moving speed; Robot state; Robot orientation; Distance; Average Speed

### 1.3 [SFW0004] The app must send as data:Moving speed; State change;Engine rotation; Engine state; Wheel angle
State change refers to AUTO and MANUAL.
Engine rotation refers to foward and reverse.
Engine state refers to on and off.

## 2 [SFW0005] The software must have an User Interface

### 2.1 [SFW0006] The interface must switch between AUTO and MANUAL mode

### 2.2 [SFW0007] In AUTO screen, the should be able to monitor robot received data, in a 1Hz refresh rate

### 2.3 [SFW0008] In MANUAL screen the user should be able to control the movement of the robot in directional mode

### 2.4 [SFW0009] In any screen the user should be able to define the robot speed

## 3 [SFW0010] The software data must be stored in short term memory, and get erased in app restart