# Requirement set stakeholder_requirements (R2024a)

## 1 [STK0001] The Robot must have two different modes of operation: [AUTO] and [MANUAL]
Rationale: Since the robot must be able to autonomously navigate a path and also be able to be controled by cellphone.

## 2 [STK0002] The Robot must follow a predetermined path autonomously when in the [AUTO] mode

### 2.1 [STK0003] The Robot must interpret a path, when in [AUTO] mode, as a white tape on a dark background
Rationale: The circuit the robot will need to follow is delimited by a white masking tape on a black matt.

### 2.2 [STK0004] The Robot, when in [AUTO] mode, must not deviate more than 3cm from the designated path

### 2.3 [STK0005] The Robot, when in [AUTO] mode, must follow a path containing turns (of up to 360 deg)
Rationale: The circuit the robot must follow may include turns

### 2.4 [STK0006] The Robot, when in [AUTO] mode, must follow a path containing intersections by keeping its original heading
Rationale: The circuit that the robot must follow may consist of intersactions

## 3 [STK0007] The Robot, when in [AUTO] mode, must stop at the end of the circuit

### 3.1 [STK0008] The Robot, when in [AUTO] mode, must interpret the end of the circuit as a series of 3 white lines on the ground perpendicular to its current heading

## 4 [STK0009] The Robot's [ROBOT_MAX_SPEED], when in [AUTO] mode, must be configurable via cellphone

## 5 [STK0010] The Robot's [ROBOT_PARAM], when in [AUTO] mode, must be remotely monitored via cellphone

### 5.1 [STK0011] The Robot's [ROBOT_PARAM] must contain [ROBOT_TOTAL_DISTANCE]

### 5.2 [STK0012] The Robot's [ROBOT_PARAM] must contain [ROBOT_CURRENT_SPEED]

### 5.3 [STK0013] The Robot's [ROBOT_PARAM] must contain [ROBOT_AVG_SPEED]

### 5.4 [STK0014] The Robot's [ROBOT_PARAM] must contain [ROBOT_ORIENTATION]

### 5.5 [STK0015] The Robot's [ROBOT_PARAM], when in [AUTO] mode, must be updated as a 1Hz frequency

## 6 [STK0016] The Robot, when in [MANUAL] mode, must be controled via cellphone

## 7 [STK0017] The Robot must stop and sound an alarm when an obstacle is detected in front

## 8 [STK0018] The Robot must stop moving when a collision is detected

## 9 [#19]